# Dynamo graph import_layout.dyn (Dynamo 4.2.1.5887)

python_script = Python()  # PythonNet3; unwired: IN[0]
# ---------- python_script.python (123 lines) ----------
import json
import clr

# 1. Import the Revit API

clr.AddReference("RevitAPI")

from Autodesk.Revit.DB import (
    XYZ, Line, Plane, SketchPlane,
    UnitUtils, UnitTypeId, ViewType
)

clr.AddReference("RevitServices")

from RevitServices.Persistence import DocumentManager
from RevitServices.Transactions import TransactionManager


# 2. Access the current Revit document

doc = DocumentManager.Instance.CurrentDBDocument
view = doc.ActiveView

if view.ViewType != ViewType.FloorPlan:
    raise ValueError("Open a floor plan view before running")


# 3. Read our generated layout

file_path = r"C:\Users\enriq\OneDrive\Documents\Disco Duro\Architecture\BIM\brief-to-bim\outputs\best_layout.json"

with open(file_path, "r", encoding="utf-8") as file:
    layout = json.load(file)

rooms = layout["rooms"]

building_width = layout["building_width"]
building_height = layout["building_height"]


# 4. Convert metres into Revit's internal units

def to_revit(value):
    return UnitUtils.ConvertToInternalUnits(
        float(value),
        UnitTypeId.Meters
    )


# 5. Create Revit XYZ points

level_z = view.GenLevel.Elevation

def point(x, y):
    return XYZ(to_revit(x), to_revit(y), level_z)


# 6. Start a Revit transaction

TransactionManager.Instance.EnsureInTransaction(doc)

plane = Plane.CreateByNormalAndOrigin(
    XYZ.BasisZ,
    XYZ(0, 0, level_z)
)

sketch_plane = SketchPlane.Create(doc, plane)

created = 0

try:

    # 7. Draw room boundaries

    for room in rooms:

        x = room["x"]
        y = room["y"]
        w = room["width"]
        h = room["height"]

        # Left and bottom edges
        segments = [
            (point(x, y), point(x, y + h)),
            (point(x, y), point(x + w, y))
        ]

        # Exterior right boundary
        if abs(x + w - building_width) < 1e-6:
            segments.append((
                point(x + w, y),
                point(x + w, y + h)
            ))

        # Exterior top boundary
        if abs(y + h - building_height) < 1e-6:
            segments.append((
                point(x, y + h),
                point(x + w, y + h)
            ))

        for start, end in segments:

            line = Line.CreateBound(start, end)

            doc.Create.NewModelCurve(
                line,
                sketch_plane
            )

            created += 1

finally:
    TransactionManager.Instance.TransactionTaskDone()


# 8. Return a summary to Dynamo

OUT = (
    f"Imported {len(rooms)} spaces | "
    f"Created {created} Revit model lines | "
    f"Seed {layout['seed']}"
)
# ----------------------------------------
